# Grasshopper definition 250413_test_01.gh (Grasshopper 1.0.8)
# plug-ins: gh_docstring

datacarrier = DataCarrier(PluginMetadata_DocStringInfo="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")
range = Range(Domain="0 to 1", Steps=Slider(74, range=0..100))
graph = GraphMapper(
    range,
    x0=0,
    x1=1,
    y0=0,
    y1=1,
    container_name="Bezier",
    cpx=[0, 0.3946496546, 0.9120975733, 1],
    cpy=[1, 0.6183825731, 0.1168026924, 1])
graph_2 = GraphMapper(
    range,
    x0=0,
    x1=1,
    y0=0,
    y1=1,
    container_name="Bezier",
    cpx=[0, 0.3680359721, 0.8927537203, 1],
    cpy=[0.03547292948, 0.4342094064, 0.3797098994, 1])
dom = ConstructDomain(DomainStart="0", DomainEnd=Slider(12, range=0..100))
remap = RemapNumbers(Value=graph, Source="0 to 1", Target=dom)  # -> Mapped, Clipped
rev = ReverseList(List=remap.Mapped)
cir = Circle(Plane=PlaneXY(0, 0, 0), Radius=rev)
Z = UnitZ(Factor=1)
remap_2 = RemapNumbers(Value=graph_2, Source="0 to 1", Target=Slider(61, range=0..120))  # -> Mapped, Clipped
amp = Amplitude(Vector=Z, Amplitude=remap_2.Mapped)
move = Move(Geometry=graft(cir), Motion=graft(amp))  # -> flatten(Geometry), Transform
loft = Loft(Curves=move.Geometry, Options={Adjust=False, Closed=False, LoftEnds=0, LoftSimp=0, LoftType=0, Rebuild=10, Refit=0.01})
cap = CapHoles(Brep=loft)
